# Dynamo graph EnergyAnalysisForDynamo_ex1b_CreateEnergyModelAndSetSurfaceParams.dyn (Dynamo 0.7.2.17586)

# note: 1. Select Mass element from Revit/Vasari document
select_model_element = DSModelElementSelection()
levels = Levels(index=0)
# note: 2. Create Analysis Zones From Mass and Levels
createEnergyModelFromMassAndLevels = EnergyAnalysisForDynamo.PrepareEnergyModel.CreateEnergyModelFromMassAndLevels(select_model_element, levels)
surface_index = IntegerSlider(3, range=0..10)
getItemAtIndex = List.GetItemAtIndex(createEnergyModelFromMassAndLevels.out2, surface_index)
glazing = DoubleSlider(0.8, range=0.2..0.8)
shading_depth = DoubleSlider(3, range=0.2..3)
sill_height = DoubleSlider(0.386, range=0..5)
conceptual_construction_types = ConcConstTypeDropdown(index=0)  # "Conceptual Construction Types Dropdown"
# note: 4. Customize parameters for the surface of interest
setSurfaceParameters = EnergyAnalysisForDynamo.PrepareEnergyModel.SetSurfaceParameters(getItemAtIndex, glazing, shading_depth, sill_height, conceptual_construction_types)
# note: 3. Draw Surfaces
drawAnalysisSurface = EnergyAnalysisForDynamo.PrepareEnergyModel.DrawAnalysisSurface(createEnergyModelFromMassAndLevels.out2)
# note: 3. Select the node
getItemAtIndex_2 = List.GetItemAtIndex(drawAnalysisSurface, surface_index)
