# Dynamo graph EnergyAnalysisForDynamo_ex4a_CreateNewProjetAndGetProjectLists.dyn (Dynamo 0.7.2.16963)

code_block = CodeBlock { "TestNewProjectfromDynamo"; }
# note: 1. To run an energy analysis using Green Buidling Studio you need to create a new GBS project. You can set up and run multiple design options under a single GBS project.
# Pick a name that helps you remember the details about the project later on.
createNewProject = EnergyAnalysisForDynamo.RunAnalysis.CreateNewProject(code_block)
boolean = BoolSelector(false)
# note: 2. To get access to one of the older projects or the project that you just created in this example file you can use GetProjectsList node
getProjectsList = EnergyAnalysisForDynamo.GetAnalysisResults.GetProjectsList(boolean)
watch = Watch(getProjectsList.out1)
