# Dynamo custom node IterativeGlazing.dyf (Dynamo 0.7.2.2114)
# category: EnergyAnalysisForDynamo.PrepareEnergyModel.Actions
# Example of a custom parametric run

FilePath = Input()
MassFamilyInstance = Input()
SurfaceId = Input()
glazingPercent = Input()
code_block = CodeBlock { 1; }
setWallSurfaceParameters = EnergyAnalysisForDynamo.PrepareEnergyModel.SetWallSurfaceParameters(SurfaceId, glazingPercent, arg3=code_block)
end = Revit.Transaction.Transaction.End(setWallSurfaceParameters)
isNull = Object.IsNull(end)
code_block_2 = CodeBlock { 0; }
code_block_3 = CodeBlock { 1; }
if_ = If(isNull, code_block_2, code_block_3)
exportMassToGBXML = EnergyAnalysisForDynamo.RunAnalysis.ExportMassToGBXML(FilePath, MassFamilyInstance, if_)
gbXMLfilePath = Output(exportMassToGBXML.out1)
