# Dynamo graph EnergyAnalysisForDynamo_ex1a_SetProjectEnergySettings.dyn (Dynamo 0.7.2.17586)

building_type_dropdown = BuildingTypeDropdown(index=0)
glazing_percentage = DoubleSlider(0.6, range=0..1)
shade_depth = DoubleSlider(2, range=0..3)
hvac_system_type_dropdown = HVACtypeDropdown(index=0)
operating_schedules_dropdown = OperatingSchedulesDropdown(index=0)
# note: Use this node to Modify Energy Settings Parameters in Project level.
# This setting will be applied to all the zones and surfaces in your model. You can use SetSurfaceParameters and SetZoneParameters to customize the setting for selected zones or surfaces.
setEnergySettings = EnergyAnalysisForDynamo.EnergySettings.SetEnergySettings(building_type_dropdown, glazing_percentage, shade_depth, hvac_system_type_dropdown, operating_schedules_dropdown)
