# Dynamo graph EnergyAnalysisForDynamo_ex2a_DriveSurfacesByOrientation.dyn (Dynamo 0.7.2.16963)

# note: 1. Select Mass element from Revit/Vasari document
select_model_element = DSModelElementSelection()
# note: 2. Create Analysis Zones from Mass
createEnergyModelFromMass = EnergyAnalysisForDynamo.PrepareEnergyModel.CreateEnergyModelFromMass(select_model_element)
YAxis = Vector.YAxis()
analysisSurfaceVector = EnergyAnalysisForDynamo.PrepareEnergyModel.AnalysisSurfaceVector(createEnergyModelFromMass.out2)
dot = Vector.Dot(YAxis, analysisSurfaceVector)
min_glazing = DoubleSlider(0.8, range=0.2..0.8)
max_glazing = DoubleSlider(0.2, range=0.2..0.8)
remapRange = Math.RemapRange(dot, min_glazing, max_glazing)
# note: 3.  Set Glazing percentage per orientation
setSurfaceParameters = EnergyAnalysisForDynamo.PrepareEnergyModel.SetSurfaceParameters(createEnergyModelFromMass.out2, remapRange)
# note: 4. Draw Surfaces
drawAnalysisSurface = EnergyAnalysisForDynamo.PrepareEnergyModel.DrawAnalysisSurface(setSurfaceParameters)
