# Dynamo graph EnergyAnalysisForDynamo_ex4b_UploadgbxmlAndCreateBaseRun.dyn (Dynamo 0.7.2.16963)

boolean = BoolSelector(true)
# note: 1. Now that you have a project created and have a gbXML file from your model you can go ahead and run the analysis.
getProjectsList = EnergyAnalysisForDynamo.GetAnalysisResults.GetProjectsList(boolean)
watch = Watch(getProjectsList)
integer_slider = IntegerSlider(0, range=0..10)
# note: 2. Select the project
getItemAtIndex = List.GetItemAtIndex(getProjectsList, integer_slider)
# note: 3. Select gbXML file
file_path = Filename("C:\Users\MSadeghipourroudsari\Documents\GitHub\EnergyAnalysisForDynamo\exampleFiles\gbxml TESTDATA\demo_testdata.xml")
# note: This node uploads the gbXML file to GBS, runs the energy analysis under the project.
# I suggest you to visit https://gbs.autodesk.com/GBS and get yourself familiarized with the app.
# note: Green Building Studio has an inbuilt parametric run engine which will execute a number of simulations on top of your model. Default in Dynamo node is set to false however you can turn it on by setting the ExecuteParametricRuns to True.
# You can read more about parametric runs here:
# http://knowledge.autodesk.com/support/green-building-studio/learn-explore/caas/CloudHelp/cloudhelp/ENU/BPA-GBSWebService/files/GUID-F4D32E61-1A3A-4AE5-B476-217860E8F3CB-htm.html
runEnergyAnalysis = EnergyAnalysisForDynamo.RunAnalysis.RunEnergyAnalysis(getItemAtIndex, file_path)
# note: Once the study is over you can use the RunId to load the results from GBS!
watch_2 = Watch(runEnergyAnalysis)
# note: To load Ids for parametric runs you can use GetRunIds node. Check next example file to see it in action.
getRunIds = EnergyAnalysisForDynamo.GetAnalysisResults.GetRunIds(getItemAtIndex)
