# Dynamo graph GBSforDynamo_ex1b_CreateEnergyModelAndSetSurfaceParams.dyn (Dynamo 0.7.2.17586)

# note: 1. Select Mass element from Revit/Vasari document
select_model_element = DSModelElementSelection()
levels = Levels(index=0)
# note: 2. Create Analysis Zones From Mass and Levels
createFromMassAndLevels = GBSforDynamo.AnalysisZones.CreateFromMassAndLevels(select_model_element, levels)
surface_index = IntegerSlider(6, range=0..10)
getItemAtIndex = List.GetItemAtIndex(createFromMassAndLevels.out2, surface_index)
glazing = DoubleSlider(0.7, range=0.2..0.8)
shading_depth = DoubleSlider(3, range=0.2..3)
sill_height = DoubleSlider(0.386, range=0..5)
setSurfaceParameters = GBSforDynamo.AnalysisZones.SetSurfaceParameters(getItemAtIndex, glazing, shading_depth, sill_height)
# note: 3. Draw Surfaces
drawAnalysisSurface = GBSforDynamo.AnalysisZones.DrawAnalysisSurface(createFromMassAndLevels.out2)
# note: 4. Set Surface parameters
getItemAtIndex_2 = List.GetItemAtIndex(drawAnalysisSurface, surface_index)
conceptual_construction_types = ConcConstTypeDropdown(index=0)  # "Conceptual Construction Types Dropdown"
