# Dynamo graph GBSforDynamo_ex3a_CreategbXMLfromMass.dyn (Dynamo 0.7.2.17586)

file_path = Filename("No file selected.")
# note: 1. Set the file location and name it.
# File extention is not needed
# note: 2. Select Mass from Revit/Vasari document
select_model_element = DSModelElementSelection()
boolean = BoolSelector(true)
# note: 3. Compile gbXML file from Mass
gbXMLCompilerFromMass = GBSforDynamo.GBSConnection.gbXMLCompilerFromMass(file_path, select_model_element, boolean)
