# Dynamo graph Demo-ableNodes_gbXMLcompiler.dyn (Dynamo 0.7.1.17276)

file_path = Filename("C:\Users\EErtugrul\Desktop\TestGBS0010")
select_model_element = DSModelElementSelection()  # 1 picked in the model
createFromMass = GBSforDynamo.AnalysisZones.CreateFromMass(select_model_element)
boolean = BoolSelector(true)
gbXMLCompiler_fromZones = GBSforDynamo.GBSConnection.gbXMLCompiler_fromZones(file_path, createFromMass.out1, boolean)
watch = Watch(createFromMass.out1)
file_path_2 = Filename("C:\Users\EErtugrul\Desktop\TestGBS0020")
boolean_2 = BoolSelector(true)
gbXMLCompiler_fromMass = GBSforDynamo.GBSConnection.gbXMLCompiler_fromMass(file_path_2, select_model_element, boolean_2)
