# Dynamo graph EnergyAnalysisForDynamo_ex1a_SetProjectEnergySettings.dyn (Dynamo 0.8.0.950)

building_type_dropdown = BuildingTypeDropdown("Courthouse")
number_slider = DoubleSlider(0.5, range=0..1 step 0.1)
number_slider_2 = DoubleSlider(0, range=0..3 step 0.1)
number_slider_3 = DoubleSlider(0, range=0..1 step 0.1)
hvac_system_type_dropdown = HVACtypeDropdown("ElevenPointThreeEERPackagedVAVEightyFourPointFourPercentBoilerHeating")
operating_schedules_dropdown = OperatingSchedulesDropdown("TwentyFourHourHourFiveDayFacility")
# note: Use this node to Modify Energy Settings Parameters in Project level.
# This setting will be applied to all the zones and surfaces in your model. You can use SetSurfaceParameters and SetZoneParameters to customize the setting for selected zones or surfaces.
setEnergySettings = EnergyAnalysisForDynamo.EnergySettings.SetEnergySettings(building_type_dropdown, number_slider, number_slider_2, number_slider_3, hvac_system_type_dropdown, operating_schedules_dropdown)
