# Dynamo graph EnergyAnalysisForDynamo_ex1b_CreateEnergyModelAndSetSurfaceParams.dyn (Dynamo 0.8.0.950)

# note: 1. Select Mass element from Revit/Vasari document
select_model_element = DSModelElementSelection()  # 1 picked in the model
levels = Levels("Level 1")
# note: 2. Create Analysis Zones From Mass and Levels
createByMassLevels = EnergyAnalysisForDynamo.PrepareEnergyModel.CreateByMassLevels(select_model_element, levels)
# note: 3. Decompose Zone and grab one wall surface
code_block = CodeBlock(x=createByMassLevels.out1) { x[1]; }
decomposeZone = EnergyAnalysisForDynamo.PrepareEnergyModel.DecomposeZone(code_block)
code_block_2 = CodeBlock(x=decomposeZone) { x[0]; }
# note: 4. Highlight the modified surface
drawAnalysisSurface = EnergyAnalysisForDynamo.PrepareEnergyModel.DrawAnalysisSurface(code_block_2)
number_slider = DoubleSlider(0.6, range=0.2..0.8 step 0.1)
number_slider_2 = DoubleSlider(0.6, range=0..1.5 step 0.1)
number_slider_3 = DoubleSlider(1.8, range=0..2 step 0.1)
conceptual_wall_construction = ConcWallConstTypeDropdown("LightweightConstructionHighInsulation")  # "Conceptual Wall Construction Types Dropdown"
# note: 5. Customize parameters for the surface of interest
setWallSurfaceParameters = EnergyAnalysisForDynamo.PrepareEnergyModel.SetWallSurfaceParameters(code_block_2, number_slider, number_slider_2, number_slider_3, conceptual_wall_construction)
