# Dynamo graph EnergyAnalysisForDynamo_ex1d_iterativeAnalysisExample.dyn (Dynamo 0.7.2.2114)

# note: 6.  Set up a custom node containing the SetSurfaceParms node, and the WriteGBxml node ... and here's the important part - a transaction end node to force vasari to export a single state.
# I think I'm writing each file 6 times ... but i assume the last write contain the correct information.  Like I said, I'm still fuzzy on nested list iteration.
# Use this node as a function to pass into the LaceLongest node.
iterativeGlazing = Custom[IterativeGlazing]()  # Example of a custom parametric run
# note: 1. Select Mass element from Revit/Vasari document
select_model_element = DSModelElementSelection()  # 1 picked in the model
levels = Levels(index=0)
# note: 2. Create Analysis Zones From Mass and Levels
createEnergyModelFromMassAndLevels = EnergyAnalysisForDynamo.PrepareEnergyModel.CreateEnergyModelFromMassAndLevels(select_model_element, levels)
# note: 3.  Define the glazing percentages to iterate over.
code_block = CodeBlock { 0.1..0.9..0.05; }
# note: 4. Set up nested lists of Surface IDs and the Glazing percentages.  I'm still fuzzy on nested list iteration ... but this seemed to work.
count = Count(code_block)
ofRepeatedItem = List.OfRepeatedItem(createEnergyModelFromMassAndLevels.out2, count)
file_path = Filename("C:\Users\BHowes\Desktop\cmon.xml")
# note: 5.  Set up a matching list of file paths - one for each glazing percentage.
fromObject = String.FromObject(file_path)
code_block_2 = CodeBlock { ".xml"; }
code_block_3 = CodeBlock { ""; }
replace = String.Replace(fromObject, code_block_2, code_block_3)
fromObject_2 = String.FromObject(code_block)
code_block_4 = CodeBlock { "."; }
code_block_5 = CodeBlock { ""; }
replace_2 = String.Replace(fromObject_2, code_block_4, code_block_5)
concat = Python(IN[0]=replace, IN[1]=replace_2)  # "Py.Concat"
# ---------- concat.python (16 lines) ----------
import clr
clr.AddReference('ProtoGeometry')
from Autodesk.DesignScript.Geometry import *
#The inputs to this node will be stored as a list in the IN variable.
dataEnteringNode = IN

outstrs = []

path = IN[0]
iter = IN[1]

for i in iter:
	outstrs.Add(str(path)+i+".xml")

#Assign your output to the OUT variable
OUT = outstrs
# ----------------------------------------
count_2 = Count(code_block)
ofRepeatedItem_2 = List.OfRepeatedItem(createEnergyModelFromMassAndLevels.out0, count_2)
laceLongest = List.LaceLongest(iterativeGlazing, ofRepeatedItem, code_block, concat, ofRepeatedItem_2)
watch = Watch(laceLongest)
watch_2 = Watch(concat)
# note: 7.  After writing the files, upload them to GBS.
code_block_6 = CodeBlock { "iterativeGlazingTester"; }
createNewProject = EnergyAnalysisForDynamo.RunAnalysis.CreateNewProject(code_block_6)
boolean = BoolSelector(false)
runEnergyAnalysis = EnergyAnalysisForDynamo.RunAnalysis.RunEnergyAnalysis(createNewProject, arg2=boolean, lacing=Longest)
