# Dynamo graph EnergyAnalysisForDynamo_ex2a_DriveSurfacesByOrientation.dyn (Dynamo 0.8.0.950)

# note: 1. Select Mass element from Revit/Vasari document
select_model_element = DSModelElementSelection()  # 1 picked in the model
# note: 2. Create Analysis Zones from Mass
createByMass = EnergyAnalysisForDynamo.PrepareEnergyModel.CreateByMass(select_model_element)
# note: 3. Get wall surfaces from the list of zones, and compute glazing percentage based on orientation
decomposeZone = EnergyAnalysisForDynamo.PrepareEnergyModel.DecomposeZone(createByMass.out1)
isEmpty = List.IsEmpty(decomposeZone, lacing=Longest)
# note: Cull Pattern _ remove empty lists
python_script = Python(IN[0]=decomposeZone, IN[1]=isEmpty)
# ---------- python_script.python (14 lines) ----------
import clr
clr.AddReference('ProtoGeometry')
from Autodesk.DesignScript.Geometry import *
#The inputs to this node will be stored as a list in the IN variable.
list = IN[0]
cullpattern = IN[1]

culledList = []
for i in range(0,len(list)):
	if (cullpattern[i] == False):
		culledList.append(list[i])

#Assign your output to the OUT variable
OUT = culledList
# ----------------------------------------
code_block = CodeBlock { 1; }
# note: Wall SurfaceIds
flatten = List.Flatten(list=python_script, amt=code_block)
YAxis = Vector.YAxis()
analysisSurfaceVector = EnergyAnalysisForDynamo.PrepareEnergyModel.AnalysisSurfaceVector(python_script)
dot = Vector.Dot(YAxis, analysisSurfaceVector)
abs = Math.Abs(dot)
code_block_2 = CodeBlock { 1; }
flatten_2 = List.Flatten(list=abs, amt=code_block_2)
number_slider = DoubleSlider(0.2, range=0.2..0.8 step 0.1)
number_slider_2 = DoubleSlider(0.8, range=0.2..0.8 step 0.1)
# note: Glazing Percentage remapped per orientation
remapRange = Math.RemapRange(numbers=flatten_2, newMin=number_slider, newMax=number_slider_2)
code_block_3 = CodeBlock { 1; }
# note: 4.  Set Glazing percentages based on orientation
setWallSurfaceParameters = EnergyAnalysisForDynamo.PrepareEnergyModel.SetWallSurfaceParameters(flatten, remapRange, arg3=code_block_3)
# note: 5. Draw Surfaces in Dynamo
drawAnalysisSurface = EnergyAnalysisForDynamo.PrepareEnergyModel.DrawAnalysisSurface(setWallSurfaceParameters)
