# Dynamo graph EnergyAnalysisForDynamo_ex3b_CreategbXMLfromZones.dyn (Dynamo 0.7.4.3245)

# note: 2. Set filepath and name of gbXML file and selects Zones to be exported as gbXML
file_path = Filename("C:\Users\BHowes\Desktop\exportGBxmlTest_002.xml")
# note: 1. Select Mass from Revit/Vasari document
select_model_element = DSModelElementSelection()  # 1 picked in the model
createByMass = EnergyAnalysisForDynamo.PrepareEnergyModel.CreateByMass(select_model_element)
empty = List.Empty()
# note: 3. Select Mass from Revit/Vasari document for context shading
boolean = BoolSelector(true)
# note: 4. To run an energy analysis you need to compile a gbXML file from a Mass or zones.
# This node will export a gbXML file from selected zones. Unlike ExportMassToGBXML you have the chance to select the zones that you want to be exported and also modify zone or surface parameters.
exportZonesToGBXML = EnergyAnalysisForDynamo.RunAnalysis.ExportZonesToGBXML(file_path, createByMass.out1, empty, boolean)
watch = Watch(exportZonesToGBXML.out0)
watch_2 = Watch(exportZonesToGBXML.out1)
