# Dynamo graph EnergySimForDynamo_ex1b_CreateEnergyModelAndSetSurfaceParams.dyn (Dynamo 0.7.2.16963)

# note: 3. Draw Surfaces
drawAnalysisSurface = EnergyAnalysisForDynamo.PrepareEnergyModel.DrawAnalysisSurface()
surface_index = IntegerSlider(3, range=0..10)
getItemAtIndex = List.GetItemAtIndex(drawAnalysisSurface, surface_index)
conceptual_construction_types = ConcConstTypeDropdown(index=0)  # "Conceptual Construction Types Dropdown"
code_block = CodeBlock { "MassRunOffIntegrated"; }
code_block_2 = CodeBlock { 239532; }
createNewProject = EnergyAnalysisForDynamo.RunAnalysis.CreateNewProject()
code_block_3 = CodeBlock { 1; }
getProjectsList = EnergyAnalysisForDynamo.GetAnalysisResults.GetProjectsList(code_block_3)
integer_slider = IntegerSlider(2, range=0..10)
getItemAtIndex_2 = List.GetItemAtIndex(getProjectsList, integer_slider)
runEnergyAnalysis = EnergyAnalysisForDynamo.RunAnalysis.RunEnergyAnalysis(getItemAtIndex_2)
getRunIds = EnergyAnalysisForDynamo.GetAnalysisResults.GetRunIds(getItemAtIndex_2)
watch = Watch(getRunIds)
getRunIds_2 = EnergyAnalysisForDynamo.GetAnalysisResults.GetRunIds()
loadAnalysisResults = EnergyAnalysisForDynamo.GetAnalysisResults.LoadAnalysisResults()
getEnergyModelFiles = EnergyAnalysisForDynamo.GetAnalysisResults.GetEnergyModelFiles()
getItemAtIndex_3 = List.GetItemAtIndex(arg1=surface_index)
glazing = DoubleSlider(0.8, range=0.2..0.8)
shading_depth = DoubleSlider(3, range=0.2..3)
sill_height = DoubleSlider(0.386, range=0..5)
# note: 4. Set Surface parameters
setSurfaceParameters = EnergyAnalysisForDynamo.PrepareEnergyModel.SetSurfaceParameters(getItemAtIndex_3, glazing, shading_depth, sill_height)
code_block_4 = CodeBlock { 1; }
getProjectsList_2 = EnergyAnalysisForDynamo.GetAnalysisResults.GetProjectsList(code_block_4)
code_block_5 = CodeBlock(x=getProjectsList_2) { x[0]; }
code_block_6 = CodeBlock { "c:/test/testNewConfig5_2.xml"; }
# note: 1. Select Mass element from Revit/Vasari document
select_model_element = DSModelElementSelection()  # 1 picked in the model
levels = Levels(index=0)
# note: 2. Create Analysis Zones From Mass and Levels
createEnergyModelFromMassAndLevels = EnergyAnalysisForDynamo.PrepareEnergyModel.CreateEnergyModelFromMassAndLevels(select_model_element, levels)
exportMassToGBXML = EnergyAnalysisForDynamo.RunAnalysis.ExportMassToGBXML(code_block_6, createEnergyModelFromMassAndLevels, code_block_4)
code_block_7 = CodeBlock { 0; }
runEnergyAnalysis_2 = EnergyAnalysisForDynamo.RunAnalysis.RunEnergyAnalysis(code_block_5, exportMassToGBXML.out1, code_block_7)
