# Dynamo graph EnergySimForDynamo_ex4a_CreateNewProjetAndGetProjectLists.dyn (Dynamo 0.7.2.17586)

code_block = CodeBlock { "TestNewProjectfromDynamo"; }
# note: Create New GBS Project
# Building Type and Operating Schedule Type will be read from Energy Settings of the current Revit/ Vasari document
createNewProject = GBSforDynamo.GBSConnection.CreateNewProject(code_block)
# note: Get List of GBS Projects
boolean = BoolSelector(false)
getProjectLists = GBSforDynamo.GBSConnection.GetProjectLists(boolean)
getEnergySettings = GBSforDynamo.EnergySettings.GetEnergySettings()
watch = Watch(getEnergySettings.out0)
watch_2 = Watch(getEnergySettings.out4)
