# Dynamo graph EnergySimForDynamo_ex4b_UploadgbxmlAndCreateBaseRun.dyn (Dynamo 0.7.2.17586)

boolean = BoolSelector(true)
# note: Get Project Lists from GBS
getProjectLists = GBSforDynamo.GBSConnection.GetProjectLists(boolean)
# note: Select the project to upload gbxml
code_block = CodeBlock(x=getProjectLists) { x[0]; }
file_path = Filename("C:\Users\EErtugrul\Documents\GitHub\GBSforDynamo\exampleFiles\gbxml TESTDATA\demo_testdata.xml")
# note: Upload gbxml to existing GBS project and Create Base Run
# You can create multiple Base run to a project
createBaseRun = GBSforDynamo.GBSConnection.CreateBaseRun(code_block, file_path)
