# Dynamo graph Demo_1_iterativeAnalysisExample.dyn (Dynamo 0.7.5.3235)

# note: 6.  Set up a custom node containing the SetSurfaceParms node, and the WriteGBxml node ... and here's the important part - a transaction end node to force vasari to export a single state.
# I think I'm writing each file 6 times ... but i assume the last write contain the correct information.  Like I said, I'm still fuzzy on nested list iteration.
# Use this node as a function to pass into the LaceLongest node.
iterativeGlazing = Custom[IterativeGlazing]()  # Example of a custom parametric run
# note: 1. Select Mass element from Revit/Vasari document
select_model_element = DSModelElementSelection()  # 1 picked in the model
levels = Levels("Level 1")
# note: 2. Create Analysis Zones From Mass and Levels
createEnergyModelFromMassAndLevels = EnergyAnalysisForDynamo.PrepareEnergyModel.CreateEnergyModelFromMassAndLevels(select_model_element, levels)
# note: 3.  Define the glazing percentages to iterate over.
code_block = CodeBlock { 0.1..0.9..#6; }
file_path = Filename("C:\Users\EErtugrul\Desktop\DemoIterativefiles\iterative.xml")
# note: 4. Set up nested lists of Surface IDs and the Glazing percentages.  I'm still fuzzy on nested list iteration ... but this seemed to work.
# note: 5.  Set up a matching list of file paths - one for each glazing percentage.
iterativeRunsPreparation = Python(IN[0]=createEnergyModelFromMassAndLevels.out0, IN[1]=createEnergyModelFromMassAndLevels.out2, IN[2]=code_block, IN[3]=file_path)  # "Py.IterativeRunsPreparation"
# ---------- iterativeRunsPreparation.python (38 lines) ----------
import clr

clr.AddReference('ProtoGeometry')
from Autodesk.DesignScript.Geometry import *

# This script prepares inputs for iterative analysis
# By Mostapha Sadeghipour Roudsari
# MRoudsari@ThorntonTomasetti.com

#The inputs to this node will be stored as a list in the IN variable.
massFamilyInstance = IN[0]
wallSurfaceIds = IN[1]
glazingPercentages = IN[2]
fileName = IN[3]

if fileName.lower().EndsWith(".xml"):
	baseFileName = fileName[:-4]
else:
	baseFileName = fileName
	
# We need to repeat mass and surfaces for each iteration

# Empty lists
masses = []
surfaces = []
filePaths = []

for percentage in glazingPercentages:
	# add mass id to the list
	masses.append(massFamilyInstance)
	# add surface id(s) to the list
	surfaces.append(wallSurfaceIds)
	# create new file names
	newFileName = baseFileName + "_" + str(percentage) + ".xml"
	filePaths.append(newFileName)
	
#Assign your output to the OUT variable
OUT = [surfaces, glazingPercentages, filePaths, masses]
# ----------------------------------------
code_block_2 = CodeBlock(x=iterativeRunsPreparation) { x[0]; x[1]; x[2]; x[3]; }
laceLongest = List.LaceLongest(iterativeGlazing, code_block_2.out0, code_block_2.out1, code_block_2.out2, code_block_2.out3)
# note: 7.  After writing the files, upload them to GBS.
code_block_3 = CodeBlock { "iterativeGlazingDemo_2"; }
createProject = EnergyAnalysisForDynamo.RunAnalysis.CreateProject(code_block_3)
gbxml_file_locations = Watch(code_block_2.out2)
boolean = BoolSelector(false)
runEnergyAnalysis = EnergyAnalysisForDynamo.RunAnalysis.RunEnergyAnalysis(createProject, gbxml_file_locations, boolean)
