# Dynamo graph Demo_2_GBS Web UI and SSO Issues.dyn (Dynamo 0.7.4.3192)

boolean = BoolSelector(true)
# note: Sign in as different Users ! Try to  Get Project List
# 1. Get project List
# 2. Create new Project _ The GetProjectList not updates the list automatically, set false run and set true.
# 3. Sign out Autodesk 360 and sign in as different user !
getProjectsList = EnergyAnalysisForDynamo.GetAnalysisResults.GetProjectsList(boolean)
# note: EE: GBS project named "IterativeGlazingTester" is not shown at the GBS Web Browser since it was deleted but API returns the deleted item as well !
watch = Watch(getProjectsList.out1)
createProject = EnergyAnalysisForDynamo.RunAnalysis.CreateProject()
code_block = CodeBlock { "demo-2"; }
