# Dynamo graph GBSforDynamo_ex1b_CreateEnergyModelAndSetSurfaceParams.dyn (Dynamo 0.7.2.16963)

# note: 1. Select Mass element from Revit/Vasari document
select_model_element = DSModelElementSelection()  # 1 picked in the model
levels = Levels(index=0)
# note: 2. Create Analysis Zones From Mass and Levels
createFromMassAndLevels = EnergyAnalysisForDynamo.PrepareEnergyModel.CreateFromMassAndLevels(select_model_element, levels)
# note: 3. Draw Surfaces
drawAnalysisSurface = EnergyAnalysisForDynamo.PrepareEnergyModel.DrawAnalysisSurface(createFromMassAndLevels.out2)
surface_index = IntegerSlider(3, range=0..10)
getItemAtIndex = List.GetItemAtIndex(drawAnalysisSurface, surface_index)
conceptual_construction_types = ConcConstTypeDropdown(index=0)  # "Conceptual Construction Types Dropdown"
getItemAtIndex_2 = List.GetItemAtIndex(arg1=surface_index)
glazing = DoubleSlider(0.8, range=0.2..0.8)
shading_depth = DoubleSlider(3, range=0.2..3)
sill_height = DoubleSlider(0.386, range=0..5)
# note: 4. Set Surface parameters
setSurfaceParameters = EnergyAnalysisForDynamo.PrepareEnergyModel.SetSurfaceParameters(getItemAtIndex_2, glazing, shading_depth, sill_height)
code_block = CodeBlock { "changedMass"; }
createNewProject = EnergyAnalysisForDynamo.RunEnergyAnalysis.CreateNewProject(code_block)
code_block_2 = CodeBlock { "c:/test/testNewConfig2.xml"; }
code_block_3 = CodeBlock { 1; }
gbXMLCompilerFromMass = EnergyAnalysisForDynamo.RunEnergyAnalysis.gbXMLCompilerFromMass(code_block_2, createFromMassAndLevels.out0, code_block_3)
createBaseRun = EnergyAnalysisForDynamo.RunEnergyAnalysis.CreateBaseRun(createNewProject, gbXMLCompilerFromMass.out1)
results_EnergyAndCarbonResults = EnergyAnalysisForDynamo.GetAnaysisResults.Results_EnergyAndCarbonResults(createBaseRun)
results_GetElectricPowerPlantSources = EnergyAnalysisForDynamo.GetAnaysisResults.Results_GetElectricPowerPlantSources(results_EnergyAndCarbonResults)
code_block_4 = CodeBlock { 420420; }
