# Dynamo graph GBSforDynamo_ex1c_CreateEnergyModelAndSetZoneParams.dyn (Dynamo 0.7.2.16963)

select_model_element = DSModelElementSelection()  # 1 picked in the model
levels = Levels(index=0)
createFromMassAndLevels = GBSforDynamo.AnalysisZones.CreateFromMassAndLevels(select_model_element, levels)
surface_index = IntegerSlider(0, range=0..10)
getItemAtIndex = List.GetItemAtIndex(createFromMassAndLevels.out1, surface_index)
# note: Should be replaced with drop down
code_block = CodeBlock { "ActiveStorage"; }
code_block_2 = CodeBlock { "Heated"; }
setZoneParameters = GBSforDynamo.AnalysisZones.SetZoneParameters(getItemAtIndex, code_block, code_block_2)
decomposeMassZone = GBSforDynamo.AnalysisZones.DecomposeMassZone(setZoneParameters)
watch = Watch(decomposeMassZone.out0)
watch_2 = Watch(decomposeMassZone.out2)
watch_3 = Watch(createFromMassAndLevels.out1)
drawAnalysisZone = GBSforDynamo.AnalysisZones.DrawAnalysisZone(select_model_element, getItemAtIndex)
