# Dynamo graph GBSforDynamo_ex2a_DriveSurfacesByOrientation.dyn (Dynamo 0.7.2.17586)

# note: 1. Select Mass element from Revit/Vasari document
select_model_element = DSModelElementSelection()  # 1 picked in the model
# note: 2. Create Analysis Zones from Mass
createFromMass = GBSforDynamo.AnalysisZones.CreateFromMass(select_model_element)
YAxis = Vector.YAxis()
analysisSurfaceVector = GBSforDynamo.AnalysisZones.AnalysisSurfaceVector(createFromMass.out2)
dot = Vector.Dot(YAxis, analysisSurfaceVector)
min_glazing = DoubleSlider(0.8, range=0.2..0.8)
max_glazing = DoubleSlider(0.2, range=0.2..0.8)
remapRange = Math.RemapRange(dot, min_glazing, max_glazing)
# note: 3.  Set Glazing percentage per orientation
setSurfaceParameters = GBSforDynamo.AnalysisZones.SetSurfaceParameters(createFromMass.out2, remapRange)
# note: 4. Draw Surfaces
drawAnalysisSurface = GBSforDynamo.AnalysisZones.DrawAnalysisSurface(setSurfaceParameters)
