# Dynamo graph GBSforDynamo_ex2b_CreateGbsProjectRun.dyn (Dynamo 0.7.1.9856)

select_model_element = DSModelElementSelection()  # 1 picked in the model
createFromMass = GBSforDynamo.AnalysisZones.CreateFromMass(select_model_element)
YAxis = Vector.YAxis()
analysisSurfaceVector = GBSforDynamo.AnalysisZones.AnalysisSurfaceVector(createFromMass.out0, createFromMass.out2)
dot = Vector.Dot(YAxis, analysisSurfaceVector)
min_glazing = DoubleSlider(0.2, range=0.2..0.8)
max_glazing = DoubleSlider(0.8, range=0.2..0.8)
remapRange = Math.RemapRange(dot, min_glazing, max_glazing)
setSurfaceParameters = GBSforDynamo.AnalysisZones.SetSurfaceParameters(createFromMass.out2, remapRange)
drawAnalysisSurface = GBSforDynamo.AnalysisZones.DrawAnalysisSurface(createFromMass.out0, setSurfaceParameters)
code_block = CodeBlock { "FancyMassFromDynamo_001"; }
boolean = BoolSelector(true)
file_path = Filename("C:\Users\BHowes\Desktop\fancyMassTester_002.xml")
boolean_2 = BoolSelector(true)
gbXMLCompiler_fromMass = GBSforDynamo.GBSConnection.gbXMLCompiler_fromMass(file_path, arg2=boolean_2)
GBS_BaseRun = GBSforDynamo.GBSConnection.GBS_BaseRun(code_block, boolean, gbXMLCompiler_fromMass.out1)
