# Dynamo graph GBSforDynamo_ex3a_CreategbXMLfromMass.dyn (Dynamo 0.7.1.10102)

select_model_element = DSModelElementSelection()  # 1 picked in the model
createFromMass = GBSforDynamo.AnalysisZones.CreateFromMass(select_model_element)
YAxis = Vector.YAxis()
analysisSurfaceVector = GBSforDynamo.AnalysisZones.AnalysisSurfaceVector(createFromMass.out0, createFromMass.out2)
dot = Vector.Dot(YAxis, analysisSurfaceVector)
min_glazing = DoubleSlider(0.2, range=0.2..0.8)
max_glazing = DoubleSlider(0.8, range=0.2..0.8)
remapRange = Math.RemapRange(dot, min_glazing, max_glazing)
setSurfaceParameters = GBSforDynamo.AnalysisZones.SetSurfaceParameters(createFromMass.out2, remapRange)
drawAnalysisSurface = GBSforDynamo.AnalysisZones.DrawAnalysisSurface(createFromMass.out0, setSurfaceParameters)
file_path = Filename("C:\Users\EErtugrul\Desktop\gbXMLcompilerfromMass-1.xml")
select_model_element_2 = DSModelElementSelection()  # 1 picked in the model
boolean = BoolSelector(true)
gbXMLCompiler_fromMass = GBSforDynamo.GBSConnection.gbXMLCompiler_fromMass(file_path, select_model_element_2, boolean)
