# Dynamo graph GBSforDynamo_ex3b_CreategbXMLfromZones.dyn (Dynamo 0.7.2.17586)

# note: 2. Set the file path and name of gbXML file & Selects Zones to be compiled
file_path = Filename("C:\Users\MSadeghipourroudsari\Desktop\test2.XML")
# note: 1. Select Mass from Revit/Vasari document
select_model_element = DSModelElementSelection()
createFromMass = GBSforDynamo.AnalysisZones.CreateFromMass(select_model_element)
boolean = BoolSelector(true)
# note: 3. Compile gbXML from selected Zones only
gbXMLCompilerFromZones = GBSforDynamo.GBSConnection.gbXMLCompilerFromZones(file_path, createFromMass.out1, boolean)
watch = Watch(gbXMLCompilerFromZones.out0)
watch_2 = Watch(gbXMLCompilerFromZones.out1)
