# Dynamo graph GBSforDynamo_ex3b_GetRunResult.dyn (Dynamo 0.7.1.10102)

boolean = BoolSelector(true)
getProjectLists = GBSforDynamo.GBSConnection.GetProjectLists(boolean)
code_block = CodeBlock(ProjectIds=getProjectLists) { ProjectIds[5]; }
getRunList = GBSforDynamo.GBSConnection.GetRunList(code_block)
watch = Watch(getRunList.out0)
firstItem = List.FirstItem(getRunList.out0)
firstItem_2 = List.FirstItem(getRunList.out1)
code_block_2 = CodeBlock { "gbxml"; }
file_path = Filename("C:\Users\EErtugrul\Desktop\Test")
getRunResult = GBSforDynamo.GBSConnection.GetRunResult(firstItem, firstItem_2, code_block_2, file_path)
