# Dynamo graph GBSforDynamo_ex4a_CreateNewProjetAndGetProjectLists.dyn (Dynamo 0.7.2.17586)

code_block = CodeBlock { TestNewProjectfromDynamo; }
# note: Create New GBS Project
createNewProject = GBSforDynamo.GBSConnection.CreateNewProject(code_block)
boolean = BoolSelector(false)
getProjectLists = GBSforDynamo.GBSConnection.GetProjectLists(boolean)
