# Dynamo graph GBSforDynamo_ex4b_UploadgbxmlAndCreateBaseRun.dyn (Dynamo 0.7.2.17586)

boolean = BoolSelector(true)
getProjectLists = GBSforDynamo.GBSConnection.GetProjectLists(boolean)
code_block = CodeBlock(x=getProjectLists) { x[0]; }
file_path = Filename("C:\Users\EErtugrul\Desktop\GBSforDynamo\resources\gbs_sdk_2012_1220\gbs.api.v1.sample\gbs.console\TestData\gbXMLfromMass.xml")
# note: Upload gbxml to existing GBS project and Create Base Run
createBaseRun = GBSforDynamo.GBSConnection.CreateBaseRun(code_block, file_path)
