# Dynamo graph EnergyAnalysisForDynamo_ex1a_SetProjectEnergySettings.dyn (Dynamo 0.8.0.950)

building_type_dropdown = BuildingTypeDropdown("Courthouse")
glazing_percentage = DoubleSlider(0.5, range=0..1 step 0.1)
shade_depth = DoubleSlider(0, range=0..3 step 0.1)
skylight_percentage = DoubleSlider(0, range=0..1 step 0.1)
hvac_system_type_dropdown = HVACtypeDropdown("FourPipeFanCoilSystemChillerFivePointNinetySixCOPBoilersEightFourPointFiveEff")
operating_schedules_dropdown = OperatingSchedulesDropdown("TwelveHourSixDayFacility")
core_offset = DoubleSlider(10, range=0..15 step 0.1)
boolean = BoolSelector(true)
# note: Use this node to Modify Energy Settings Parameters at the Project level.
# This setting will be applied to all the zones and surfaces in your model. You can use SetSurfaceParameters and SetZoneParameters to customize the setting for selected zones or surfaces.
setEnergySettings = EnergyAnalysisForDynamo.EnergySettings.SetEnergySettings(building_type_dropdown, glazing_percentage, shade_depth, skylight_percentage, hvac_system_type_dropdown, operating_schedules_dropdown, core_offset, boolean)
