# Dynamo graph EnergyAnalysisForDynamo_ex1b_CreateEnergyModelAndSetSurfaceParams.dyn (Dynamo 0.8.0.950)

# note: 1. Select Mass element from Revit/Vasari document
select_model_element = DSModelElementSelection()  # 1 picked in the model
levels = Levels("Level 1")
# note: 2. Create Analysis Zones From Mass and Levels
createByMassLevels = EnergyAnalysisForDynamo.PrepareEnergyModel.CreateByMassLevels(select_model_element, levels)
zone_id = CodeBlock(x=createByMassLevels.out1) { x[1]; }
# note: 3. Decompose Zone
decomposeZone = EnergyAnalysisForDynamo.PrepareEnergyModel.DecomposeZone(zone_id)
# note: 4. Select One Wall Surface
wall_surface_id = CodeBlock(x=decomposeZone.out0) { x[0]; }
# note: 5. Draw Selected Wall Surface
drawAnalysisSurface = EnergyAnalysisForDynamo.PrepareEnergyModel.DrawAnalysisSurface(wall_surface_id)
glazing_percentage = DoubleSlider(0.3, range=0.2..0.8 step 0.1)
shading_depth = DoubleSlider(0.6, range=0..1.5 step 0.1)
sill_height = DoubleSlider(1.8, range=0..2 step 0.1)
conceptual_wall_construction = ConcWallConstTypeDropdown("HighMassConstructionTypicalColdClimateInsulation")  # "Conceptual Wall Construction Types Dropdown"
# note: 6. Set Parameters on the selected surface.
setWallSurfaceParameters = EnergyAnalysisForDynamo.PrepareEnergyModel.SetWallSurfaceParameters(wall_surface_id, glazing_percentage, shading_depth, sill_height, conceptual_wall_construction)
# note: 7. Select One Window Surface
wall_surface_id_2 = CodeBlock(x=decomposeZone.out2) { x[0]; }
conceptual_glazing_construction = ConcGlazingConstTypeDropdown("TriplePaneClearLowEHotOrColdClimate")  # "Conceptual Glazing Construction Types Dropdown"
# note: 9. Set Parameters on the selected surface.
setSurfaceConceptualConstruction = EnergyAnalysisForDynamo.PrepareEnergyModel.SetSurfaceConceptualConstruction(wall_surface_id_2, conceptual_glazing_construction)
# note: 8. Draw Window Surface
drawAnalysisSurface_2 = EnergyAnalysisForDynamo.PrepareEnergyModel.DrawAnalysisSurface(wall_surface_id_2)
