# Dynamo graph EnergyAnalysisForDynamo_ex1d_iterativeAnalysisExample.dyn (Dynamo 0.8.0.950)

# note: 6.  Set up a custom node containing the SetSurfaceParms node, and the WriteGBxml node ... and here's the important part - a transaction end node to force vasari to export a single state.
iterativeGlazing = Custom[IterativeGlazing]()  # Example of a custom parametric run
# note: 1. Select Mass element from Revit/Vasari document
select_model_element = DSModelElementSelection()  # 1 picked in the model
levels = Levels("Level 1")
# note: 2. Create Analysis Zones From Mass and Levels, and grab the exterior wall surfaces
createByMassLevels = EnergyAnalysisForDynamo.PrepareEnergyModel.CreateByMassLevels(select_model_element, levels)
decomposeZone = EnergyAnalysisForDynamo.PrepareEnergyModel.DecomposeZone(createByMassLevels.out1)
flatten = Flatten(decomposeZone)
# note: 3.  Define the glazing percentages to iterate over, and set a location to write files to like
# C:\iterativeGlazing
code_block = CodeBlock { 0.1..0.9..#4; }
file_path = Filename("C:\Users\EErtugrul\Desktop\delete\DYNAMO2.5 Test\iterativegbXML")
# note: 4. Set up nested lists of Surface IDs and the Glazing percentages.
# note: 5.  Set up a matching list of file paths - one for each glazing percentage.
iterativeRunsPreparation = Python(IN[0]=createByMassLevels.out0, IN[1]=flatten, IN[2]=code_block, IN[3]=file_path)  # "Py.IterativeRunsPreparation"
# ---------- iterativeRunsPreparation.python (38 lines) ----------
import clr

clr.AddReference('ProtoGeometry')
from Autodesk.DesignScript.Geometry import *

# This script prepares inputs for iterative analysis
# By Mostapha Sadeghipour Roudsari
# MRoudsari@ThorntonTomasetti.com

#The inputs to this node will be stored as a list in the IN variable.
massFamilyInstance = IN[0]
wallSurfaceIds = IN[1]
glazingPercentages = IN[2]
fileName = IN[3]

if fileName.lower().EndsWith(".xml"):
	baseFileName = fileName[:-4]
else:
	baseFileName = fileName
	
# We need to repeat mass and surfaces for each iteration

# Empty lists
masses = []
surfaces = []
filePaths = []

for percentage in glazingPercentages:
	# add mass id to the list
	masses.append(massFamilyInstance)
	# add surface id(s) to the list
	surfaces.append(wallSurfaceIds)
	# create new file names
	newFileName = baseFileName + "_" + str(percentage) + ".xml"
	filePaths.append(newFileName)
	
#Assign your output to the OUT variable
OUT = [surfaces, glazingPercentages, filePaths, masses]
# ----------------------------------------
code_block_2 = CodeBlock(x=iterativeRunsPreparation) { x[0]; x[1]; x[2]; x[3]; }
laceLongest = List.LaceLongest(iterativeGlazing, code_block_2.out0, code_block_2.out1, code_block_2.out2, code_block_2.out3)
# note: Input gbXML file paths into Run Energy Analysis Node
gbxml_paths = Watch(code_block_2.out2)
# note: 7.  After writing the files, upload them to GBS.
code_block_3 = CodeBlock { "IterativeEnergyModel"; }
createProject = EnergyAnalysisForDynamo.RunAnalysis.CreateProject(code_block_3)
boolean = BoolSelector(false)
runEnergyAnalysis = EnergyAnalysisForDynamo.RunAnalysis.RunEnergyAnalysis(createProject, arg2=boolean)
boolean_2 = BoolSelector(true)
# note: 8.  Load Analysis results. Enable synchronization to wait the simulations to be completed. It might take several minutes and block the Dynamo solution
loadAnalysisResults = EnergyAnalysisForDynamo.GetAnalysisResults.LoadAnalysisResults(runEnergyAnalysis, arg2=boolean_2)
