# Dynamo graph EnergyAnalysisForDynamo_ex1e_SetSurfaceParamsByOrientation.dyn (Dynamo 0.8.0.950)

# note: 1. Select Mass element from Revit/Vasari document
# Use w/ sample 'Simple Mass" model
select_model_element = DSModelElementSelection()  # 1 picked in the model
levels = Levels("Level 1")
# note: 2. Create Analysis Zones From Mass and Levels
createByMassLevels = EnergyAnalysisForDynamo.PrepareEnergyModel.CreateByMassLevels(select_model_element, levels)
# note: 3. Decompose Zones and sort Glazing by orientation
decomposeZone = EnergyAnalysisForDynamo.PrepareEnergyModel.DecomposeZone(createByMassLevels.out1)
flatten = Flatten(decomposeZone.out2)
# note: 4. Separate Analysis Surfaces by Orientation
separateSrfsByOrientation = EnergyAnalysisForDynamo.PrepareEnergyModel.SeparateSrfsByOrientation(flatten)
code_block = CodeBlock(x=separateSrfsByOrientation.out1) { x[0]; x[1]; x[2]; x[3]; }
conceptual_glazing_construction = ConcGlazingConstTypeDropdown("SinglePaneClearNoCoating")  # "Conceptual Glazing Construction Types Dropdown"
# note: The South Facing Surfaces
setSurfaceConceptualConstruction = EnergyAnalysisForDynamo.PrepareEnergyModel.SetSurfaceConceptualConstruction(code_block.out3, conceptual_glazing_construction)
create = List.Create(code_block.out0, code_block.out2)
conceptual_glazing_construction_2 = ConcGlazingConstTypeDropdown("TriplePaneClearLowEHotOrColdClimate")  # "Conceptual Glazing Construction Types Dropdown"
# note: The East and West Facing Surfaces
setSurfaceConceptualConstruction_2 = EnergyAnalysisForDynamo.PrepareEnergyModel.SetSurfaceConceptualConstruction(create, conceptual_glazing_construction_2)
conceptual_glazing_construction_3 = ConcGlazingConstTypeDropdown("SinglePaneClearNoCoating")  # "Conceptual Glazing Construction Types Dropdown"
# note: 5. Set the constructions for each orientation
# note: The North Facing Surfaces
setSurfaceConceptualConstruction_3 = EnergyAnalysisForDynamo.PrepareEnergyModel.SetSurfaceConceptualConstruction(code_block.out1, conceptual_glazing_construction_3)
