# Dynamo graph EnergyAnalysisForDynamo_ex3a_CreategbXMLfromMass.dyn (Dynamo 0.8.0.950)

# note: 1. Set the file location and name it.
# File extention is not needed
code_block = CodeBlock { "C:\Users\BHowes\Desktop\EA4D_ExampleGbxmlFromMass"; }
# note: 2. Select Mass from the Revit document
select_model_element = DSModelElementSelection()  # 1 picked in the model
empty = List.Empty()
# note: 3. Select Shading masses from Revit, or input an empty list.
boolean = BoolSelector(true)
# note: 4. To run an energy analysis you need to compile a gbXML file from a Mass or zones. This node will export a gbXML file for a mass.
exportMassToGBXML = EnergyAnalysisForDynamo.RunAnalysis.ExportMassToGBXML(code_block, select_model_element, empty, boolean)
