# Dynamo graph EnergyAnalysisForDynamo_ex3b_CreategbXMLfromZones.dyn (Dynamo 0.8.0.950)

# note: 2. Set filepath and name of gbXML file and select Zones to be exported as gbXML
code_block = CodeBlock { "C:\Users\BHowes\Desktop\EA4D_ExampleGbxmlFromZones.xml"; }
# note: 1. Select Mass from the Revit document.
select_model_element = DSModelElementSelection()  # 1 picked in the model
createByMass = EnergyAnalysisForDynamo.PrepareEnergyModel.CreateByMass(select_model_element)
# note: 3. Select Mass from Revit/Vasari document for context shading
empty = List.Empty()
boolean = BoolSelector(true)
# note: 4. To run an energy analysis you need to compile a gbXML file from a Mass or zones.
# This node will export a gbXML file from selected zones. Unlike ExportMassToGBXML you have the chance to select the zones that you want to be exported and also modify zone or surface parameters.
exportZonesToGBXML = EnergyAnalysisForDynamo.RunAnalysis.ExportZonesToGBXML(code_block, createByMass.out1, empty, boolean)
watch = Watch(exportZonesToGBXML.out0)
watch_2 = Watch(exportZonesToGBXML.out1)
