# Dynamo graph EnergyAnalysisForDynamo_ex4a_CreateNewProjectAndGetProjectLists.dyn (Dynamo 0.8.0.950)

boolean = BoolSelector(false)
# note: 2. To get access to one of the older projects or the project that you just created in this example file you can use GetProjectsList node
getProjectsList = EnergyAnalysisForDynamo.GetAnalysisResults.GetProjectsList(boolean)
watch_project_titles = Watch(getProjectsList.out1)
code_block = CodeBlock { "TestNewProjectfromDynamo"; }
# note: 1. To run an energy analysis using Green Buidling Studio you need to create a new GBS project. You can set up and run multiple design options under a single GBS project.
# Pick a name that helps you remember the details about the project later on.
createProject = EnergyAnalysisForDynamo.RunAnalysis.CreateProject(code_block)
watch_project_ids = Watch(getProjectsList.out0)
