# Dynamo graph EnergyAnalysisForDynamo_ex5a_GetRunResultsSummary.dyn (Dynamo 0.8.0.950)

boolean = BoolSelector(true)
# note: In this example file you can see how you can load the results from Green Building Studio
getProjectsList = EnergyAnalysisForDynamo.GetAnalysisResults.GetProjectsList(boolean)
# note: Select project item
select_project_item = CodeBlock(x=getProjectsList) { x[0]; }
# note: Get Run List of selected Project
getRunIds = EnergyAnalysisForDynamo.GetAnalysisResults.GetRunIds(select_project_item)
altId = CodeBlock(x=getRunIds.out2) { x[0]; }
# note: Alt run Id is defaut 0 for Base Model
# note: Check run names
watch = Watch(getRunIds.out0)
runId = CodeBlock(x=getRunIds.out1) { x[0]; }
# note: First you need to load the results for your design option and then use that to get specific results. Check the nodes on the right.
loadAnalysisResults = EnergyAnalysisForDynamo.GetAnalysisResults.LoadAnalysisResults(runId)
# note: Get Carbon Neutral Potential
getCarbonNeutralPotential = EnergyAnalysisForDynamo.GetAnalysisResults.GetCarbonNeutralPotential(loadAnalysisResults.out0)
# note: Get Energy Carbon Cost Summary
getEnergyCarbonCostSummary = EnergyAnalysisForDynamo.GetAnalysisResults.GetEnergyCarbonCostSummary(loadAnalysisResults.out0)
# note: Get Electric Power Plant Sources
getElectricPowerPlantSources = EnergyAnalysisForDynamo.GetAnalysisResults.GetElectricPowerPlantSources(loadAnalysisResults.out0)
building_summary = Watch(loadAnalysisResults.out4)
